# Grasshopper definition cgeom_geodesicPaths.gh (Grasshopper 1.0.7)
# plug-ins: Weaverbird, CGeomGH Info

mesh = Mesh(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)
wbvertices = WeaverbirdsVerticesComponent(MeshClosedPolylinesGroup=mesh, Weld=True)
item = ListItem(List=wbvertices, Index=Slider(705, range=0..3388), Wrap=True)
item_2 = ListItem(List=wbvertices, Index=Slider(0, range=0..3388), Wrap=True)
geopaths = GeodesicPaths(Mesh=mesh, SourcePoints=item_2, TargetPoints=item)
